# Dynamo graph Generative_design_computational_model.dyn (Dynamo 2.1.0.7500)

# group: Surface
code_block = CodeBlock { -85; -70; 10; }
byCoordinates = Point.ByCoordinates(x=code_block.out0, y=code_block.out1, z=code_block.out2)
code_block_2 = CodeBlock { -85; -70; 40; }
byCoordinates_2 = Point.ByCoordinates(x=code_block_2.out0, y=code_block_2.out1, z=code_block_2.out2)
byStartPointEndPoint = Line.ByStartPointEndPoint(startPoint=byCoordinates, endPoint=byCoordinates_2)
code_block_3 = CodeBlock { -150; -70; 10; }
byCoordinates_3 = Point.ByCoordinates(x=code_block_3.out0, y=code_block_3.out1, z=code_block_3.out2)
code_block_4 = CodeBlock { -150; -70; 40; }
byCoordinates_4 = Point.ByCoordinates(x=code_block_4.out0, y=code_block_4.out1, z=code_block_4.out2)
byStartPointEndPoint_2 = Line.ByStartPointEndPoint(startPoint=byCoordinates_3, endPoint=byCoordinates_4)
list_create = List.Create(item0=byStartPointEndPoint, item1=byStartPointEndPoint_2)
byLoft = Surface.ByLoft(crossSections=list_create)

code_block_5 = CodeBlock { 1; }
bottom_opposite_corner = Surface.PointAtParameter(surface=byLoft, v=code_block_5)
normalAtPoint = Surface.NormalAtPoint(surface=byLoft, point=bottom_opposite_corner)

# group: Wooden knots
number_slider = DoubleSlider(0.69, range=0..1 step 0.01)
number_slider_2 = DoubleSlider(0.79, range=0..1 step 0.01)
pointAtParameter = Surface.PointAtParameter(surface=byLoft, u=number_slider, v=number_slider_2)
number_slider_3 = DoubleSlider(7, range=0..15 step 0.2)
byCenterPointRadiusNormal = Circle.ByCenterPointRadiusNormal(centerPoint=pointAtParameter, radius=number_slider_3, normal=normalAtPoint)

top_opposite_corner = Surface.PointAtParameter(surface=byLoft, u=code_block_5, v=code_block_5)
byStartPointEndPoint_3 = Line.ByStartPointEndPoint(startPoint=top_opposite_corner, endPoint=bottom_opposite_corner)

# group: INPUT
code_block_6 = CodeBlock { 1; }
number_of_elements = IntegerSlider(44, range=5..70 step 1)  # graph input
formula = Formula("1/n", n=number_of_elements)
range = Range(end=code_block_6, step=formula)

pointAtParameter_2 = Curve.PointAtParameter(curve=byStartPointEndPoint_3, param=range, lacing=CrossProduct)
code_block_7 = CodeBlock { 1; }
pointAtParameter_3 = Surface.PointAtParameter(surface=byLoft, v=code_block_7)
bottom_point = Surface.PointAtParameter(surface=byLoft)
byTwoPoints = Vector.ByTwoPoints(start=pointAtParameter_3, end=bottom_point)
byOriginVectors = CoordinateSystem.ByOriginVectors(origin=bottom_opposite_corner, xAxis=normalAtPoint, yAxis=byTwoPoints)
YAxis = CoordinateSystem.YAxis(coordinateSystem=byOriginVectors)
top_point = Surface.PointAtParameter(surface=byLoft, u=code_block_5)
byStartPointEndPoint_4 = Line.ByStartPointEndPoint(startPoint=top_opposite_corner, endPoint=top_point)
length = Curve.Length(curve=byStartPointEndPoint_4)
byStartPointDirectionLength = Line.ByStartPointDirectionLength(startPoint=pointAtParameter_2, direction=YAxis, length=length)
code_block_8 = CodeBlock { 1; 0.1; }
integer_slider = IntegerSlider(51, range=5..100 step 1)
code_block_9 = CodeBlock(n=integer_slider) { 1/n; }
# note: Add points along horizontal lines
range_2 = Range(end=code_block_8.out0, step=code_block_9)
pointAtParameter_4 = Curve.PointAtParameter(curve=byStartPointDirectionLength@L1, param=range_2)
# note: Get distances between opening center point and all the points
distanceTo = Geometry.DistanceTo(geometry=pointAtParameter, other=pointAtParameter_4@@L1)
# note: Radius of affected points
code_block_10 = CodeBlock(r=number_slider_3) { r*2; }
le = distanceTo <= code_block_10
byTwoPoints_2 = Vector.ByTwoPoints(start=pointAtParameter, end=pointAtParameter_4, lacing=CrossProduct)
Z = Vector.Z(vector=byTwoPoints_2)
byCoordinates_5 = Vector.ByCoordinates(z=Z)
code_block_11 = CodeBlock { 0; 0; 0.01; }
byCoordinates_6 = Vector.ByCoordinates(x=code_block_11.out0, y=code_block_11.out1, z=code_block_11.out2)
if_ = If(test=le, true=byCoordinates_5, false=byCoordinates_6)

# group: Wooden knots
number_slider_4 = DoubleSlider(0.36, range=0..1 step 0.01)
number_slider_5 = DoubleSlider(0.43, range=0..1 step 0.01)
pointAtParameter_5 = Surface.PointAtParameter(surface=byLoft, u=number_slider_4, v=number_slider_5)
number_slider_6 = DoubleSlider(7, range=0..15 step 0.2)

code_block_12 = CodeBlock { 1; 0.1; }
integer_slider_2 = IntegerSlider(51, range=5..100 step 1)
code_block_13 = CodeBlock(n=integer_slider_2) { 1/n; }
range_3 = Range(end=code_block_12.out0, step=code_block_13)
pointAtParameter_6 = Curve.PointAtParameter(curve=byStartPointDirectionLength@L1, param=range_3)
distanceTo_2 = Geometry.DistanceTo(geometry=pointAtParameter_5, other=pointAtParameter_6@@L1)
code_block_14 = CodeBlock(r=number_slider_6) { r*1; }
le_2 = distanceTo_2 <= code_block_14
code_block_15 = CodeBlock { null; }
if_2 = If(test=le_2, true=distanceTo_2, false=code_block_15)
byTwoPoints_3 = Vector.ByTwoPoints(start=pointAtParameter_5, end=pointAtParameter_4, lacing=CrossProduct)
Z_2 = Vector.Z(vector=byTwoPoints_3)
byCoordinates_7 = Vector.ByCoordinates(z=Z_2)
code_block_16 = CodeBlock { 0; 0; 0.01; }
byCoordinates_8 = Vector.ByCoordinates(x=code_block_16.out0, y=code_block_16.out1, z=code_block_16.out2)
if_3 = If(test=if_2, true=byCoordinates_7, false=byCoordinates_8)
add = Vector.Add(vector=if_, vectorToAdd=if_3)

# group: Wooden knots
number_slider_7 = DoubleSlider(0.55, range=0..1 step 0.01)
number_slider_8 = DoubleSlider(0.16, range=0..1 step 0.01)
pointAtParameter_7 = Surface.PointAtParameter(surface=byLoft, u=number_slider_7, v=number_slider_8)
number_slider_9 = DoubleSlider(7, range=0..15 step 0.2)

code_block_17 = CodeBlock { 1; 0.1; }
integer_slider_3 = IntegerSlider(51, range=5..100 step 1)
code_block_18 = CodeBlock(n=integer_slider_3) { 1/n; }
range_4 = Range(end=code_block_17.out0, step=code_block_18)
pointAtParameter_8 = Curve.PointAtParameter(curve=byStartPointDirectionLength@L1, param=range_4)
distanceTo_3 = Geometry.DistanceTo(geometry=pointAtParameter_7, other=pointAtParameter_8@@L1)
code_block_19 = CodeBlock(r=number_slider_9) { r*2; }
le_3 = distanceTo_3 <= code_block_19
code_block_20 = CodeBlock { null; }
if_4 = If(test=le_3, true=distanceTo_3, false=code_block_20)
byTwoPoints_4 = Vector.ByTwoPoints(start=pointAtParameter_7, end=pointAtParameter_4, lacing=CrossProduct)
Z_3 = Vector.Z(vector=byTwoPoints_4)
byCoordinates_9 = Vector.ByCoordinates(z=Z_3)
code_block_21 = CodeBlock { 0; 0; 0.01; }
byCoordinates_10 = Vector.ByCoordinates(x=code_block_21.out0, y=code_block_21.out1, z=code_block_21.out2)
if_5 = If(test=if_4, true=byCoordinates_9, false=byCoordinates_10)
add_2 = Vector.Add(vector=add, vectorToAdd=if_5)
code_block_22 = CodeBlock { null; }
if_6 = If(test=le, true=distanceTo, false=code_block_22)
# note: Equation for the offset of the points based on the distance from the center
code_block_23 = CodeBlock(x=if_6) { -x*x/10; }
exp = Math.Exp(number=code_block_23)
code_block_24 = CodeBlock(x=if_6) { -x*x/10; 0.7; }
mul = exp * code_block_24.out1
code_block_25 = CodeBlock { null; }
eq = mul == code_block_25
code_block_26 = CodeBlock { 0; }
if_7 = If(test=eq, true=code_block_26, false=mul)
code_block_27 = CodeBlock(x=if_2) { -x*x/5; }
exp_2 = Math.Exp(number=code_block_27)
code_block_28 = CodeBlock(x=if_2) { -x*x/10; 0.5; }
mul_2 = exp_2 * code_block_28.out1
code_block_29 = CodeBlock { null; }
eq_2 = mul_2 == code_block_29
code_block_30 = CodeBlock { 0; }
if_8 = If(test=eq_2, true=code_block_30, false=mul_2)
add_3 = if_7 + if_8
code_block_31 = CodeBlock(x=if_4) { -x*x/20; }
exp_3 = Math.Exp(number=code_block_31)
code_block_32 = CodeBlock(x=if_4) { -x*x/10; 0.5; }
mul_3 = exp_3 * code_block_32.out1
code_block_33 = CodeBlock { null; }
eq_3 = mul_3 == code_block_33
code_block_34 = CodeBlock { 0; }
if_9 = If(test=eq_3, true=code_block_34, false=mul_3)
add_4 = add_3 + if_9
translate = Geometry.Translate(geometry=pointAtParameter_4@L2, direction=add_2@L2, distance=add_4@L2)
transpose = List.Transpose(lists=translate)
ZAxis = Vector.ZAxis()
count = List.Count(list=transpose@L2)
randomList = Math.RandomList(amount=count)
code_block_35 = CodeBlock { -0.1; 0.1; 3; }
remapRange = Math.RemapRange(numbers=randomList, newMin=code_block_35.out0, newMax=code_block_35.out1)
round = Math.Round(number=remapRange, digits=code_block_35.out2)
count_2 = List.Count(list=translate@L2)
code_block_36 = CodeBlock(a=count_2) { 4; a*0; }
python_script = Python(IN[0]=round, IN[1]=code_block_36.out0, IN[2]=code_block_36.out1)
# ---------- python_script.python (26 lines) ----------
# Enable Python support and load DesignScript library
import clr
clr.AddReference('ProtoGeometry')
from Autodesk.DesignScript.Geometry import *

# The inputs to this node will be stored as a list in the IN variables.
list = IN[0] 		#original list
n = IN[1] 			#every n-th item add inserting list
itemlist= IN[2] 	#inserting list

# Place your code below this line

newlist = []
j=0

for i in range(0,len(list)):
	
	if i == j:
		newlist.append(itemlist)
		j=j+n
	else:
		newlist.append(list[i])


# Assign your output to the OUT variable.
OUT = newlist
# ----------------------------------------
translate_2 = Geometry.Translate(geometry=transpose, direction=ZAxis, distance=python_script)
transpose_2 = List.Transpose(lists=translate_2)
normalAtPoint_2 = Surface.NormalAtPoint(surface=byLoft, point=transpose_2)
code_block_37 = CodeBlock { 10; }
byStartPointDirectionLength_2 = Line.ByStartPointDirectionLength(startPoint=transpose_2, direction=normalAtPoint_2, length=code_block_37)
byControlPoints = NurbsCurve.ByControlPoints(points=transpose_2)
endPoint = Curve.EndPoint(curve=byControlPoints)
code_block_38 = CodeBlock { 1; }
flatten = List.Flatten(list=byControlPoints)
code_block_39 = CodeBlock { [-139.4,-148.6,-133.2,-145.2]; -70; [45.8,30.9,24.6,6]; }
byCoordinates_11 = Point.ByCoordinates(x=code_block_39.out0, y=code_block_39.out1, z=code_block_39.out2)
code_block_40 = CodeBlock { [-132.8,-132.8,-123.6,-121.4,-131.5]; -70; [45.8,34.6,23.5,13.6,4.9]; }
byCoordinates_12 = Point.ByCoordinates(x=code_block_40.out0, y=code_block_40.out1, z=code_block_40.out2)
code_block_41 = CodeBlock { [-113.95,-120.5,-118.4,-112.5,-113.6]; -70; [45.8,41.2,31.6,27.2,7]; }
byCoordinates_13 = Point.ByCoordinates(x=code_block_41.out0, y=code_block_41.out1, z=code_block_41.out2)
code_block_42 = CodeBlock { [-98.3,-107.4,-107.4,-97.8]; -70; [44.9,32.4,20.5,6.2]; }
byCoordinates_14 = Point.ByCoordinates(x=code_block_42.out0, y=code_block_42.out1, z=code_block_42.out2)
code_block_43 = CodeBlock { [-91.1,-94.8,-88.9,-93.5]; -70; [43.9,36.8,21.8,7.2]; }
byCoordinates_15 = Point.ByCoordinates(x=code_block_43.out0, y=code_block_43.out1, z=code_block_43.out2)
list_create_2 = List.Create(item0=byCoordinates_11, item1=byCoordinates_12, item2=byCoordinates_13, item3=byCoordinates_14, item4=byCoordinates_15)
byControlPoints_2 = NurbsCurve.ByControlPoints(points=list_create_2)
# note: Difference between this two is
# just the list order or intersections
# this can be also reproduced by
# list.transpose
intersect = Geometry.Intersect(geometry=flatten, other=byControlPoints_2, lacing=CrossProduct)
count_3 = List.Count(list=intersect)
linear_sequence = Sequence(start=code_block_38, amount=count_3)
formula_2 = Formula("Sin(x/2)*1.5+x/8-Cos(x/4)+1", x=linear_sequence)
maximum_width = DoubleSlider(0.45, range=0.2..1 step 0.01)  # graph input
code_block_44 = CodeBlock(x=maximum_width) { 0.1+x/4; }
remapRange_2 = Math.RemapRange(numbers=formula_2, newMin=code_block_44, newMax=maximum_width)
translate_3 = Geometry.Translate(geometry=endPoint, direction=normalAtPoint, distance=remapRange_2)
flatten_2 = List.Flatten(list=translate_3)
startPoint = Curve.StartPoint(curve=byControlPoints)
formula_3 = Formula("Sin(x/4)*2+x/8-Cos(x/1.5)+2", x=linear_sequence)
remapRange_3 = Math.RemapRange(numbers=formula_3, newMin=code_block_44, newMax=maximum_width)
translate_4 = Geometry.Translate(geometry=startPoint, direction=normalAtPoint, distance=remapRange_3)
flatten_3 = List.Flatten(list=translate_4)
intersect_2 = Geometry.Intersect(geometry=byControlPoints_2, other=flatten, lacing=CrossProduct)
flatten_4 = List.Flatten(list=intersect_2@L3)
reverse = List.Reverse(list=remapRange_2)
list_create_3 = List.Create(item0=remapRange_2, item1=reverse, item2=remapRange_3)
number_of_shape_curves = List.Count(list=intersect_2)
# note: Makes the list count the same as there are points to offset so they are no additional points
ofRepeatedItem = List.OfRepeatedItem(item=list_create_3, amount=number_of_shape_curves)
flatten_5 = List.Flatten(list=ofRepeatedItem@L2)
code_block_45 = CodeBlock(a=number_of_shape_curves) { [0..a-1]; }
getItemAtIndex = List.GetItemAtIndex(list=flatten_5, index=code_block_45)
translate_5 = Geometry.Translate(geometry=flatten_4, direction=normalAtPoint, distance=getItemAtIndex@L2, lacing=Longest)
flatten_6 = List.Flatten(list=translate_5@L2)
addItemToFront = List.AddItemToFront(item=flatten_3, list=flatten_6)
addItemToEnd = List.AddItemToEnd(item=flatten_2, list=addItemToFront)
byControlPoints_3 = NurbsCurve.ByControlPoints(points=addItemToEnd)
byLoft_2 = Surface.ByLoft(crossSections=byControlPoints_3)
intersect_3 = Geometry.Intersect(geometry=byStartPointDirectionLength_2, other=byLoft_2)
flatten_7 = List.Flatten(list=intersect_3@L3)
byControlPoints_4 = NurbsCurve.ByControlPoints(points=flatten_7)
flatten_8 = List.Flatten(list=byControlPoints_4@L1)
flatten_9 = List.Flatten(list=byControlPoints@L1)
list_create_4 = List.Create(item0=flatten_8, item1=flatten_9)
transpose_3 = List.Transpose(lists=list_create_4)
flatten_10 = List.Flatten(list=transpose_3@L3)
byLoft_3 = Surface.ByLoft(crossSections=flatten_10)
number_slider_10 = DoubleSlider(0.2, range=0.05..1 step 0.05)

# group: OUTPUT
thicken = Surface.Thicken(surface=byLoft_3, thickness=number_slider_10)
volume = Solid.Volume(solid=thicken)
sum = Math.Sum(values=volume)
total_volume = Watch(sum)  # graph output

code_block_46 = CodeBlock(x=if_6) { -x*x/150+3; }
code_block_47 = CodeBlock { 1; 0.01; }
range_5 = Range(end=code_block_47.out0, step=code_block_47.out1)
pointAtParameter_9 = Curve.PointAtParameter(curve=byStartPointDirectionLength@L1, param=range_5)
code_block_48 = CodeBlock { 3.099; -26.992; 96.238; }
byCoordinates_16 = Vector.ByCoordinates(x=code_block_48.out0, y=code_block_48.out1, z=code_block_48.out2)
code_block_49 = CodeBlock { 6; }
byStartPointDirectionLength_3 = Line.ByStartPointDirectionLength(startPoint=pointAtParameter_9, direction=byCoordinates_16, length=code_block_49)
reverse_2 = List.Reverse(list=byStartPointDirectionLength_3)
code_block_50 = CodeBlock { -1; }
dropItems = List.DropItems(list=reverse_2, amount=code_block_50)
reverse_3 = List.Reverse(list=byLoft_3)
code_block_51 = CodeBlock { 1; }
dropItems_2 = List.DropItems(list=reverse_3, amount=code_block_51)

# group: OUTPUT - Number of light passes through the shading
doesIntersect = Geometry.DoesIntersect(geometry=dropItems, other=dropItems_2)
countTrue = List.CountTrue(list=doesIntersect)
sumer_number_of_blocked_rays = Watch(countTrue)

flatten_11 = List.Flatten(list=if_7@L3)
code_block_52 = CodeBlock { 5.346; -87.117; 48.806; }
byCoordinates_17 = Vector.ByCoordinates(x=code_block_52.out0, y=code_block_52.out1, z=code_block_52.out2)
code_block_53 = CodeBlock { 2; }
byStartPointDirectionLength_4 = Line.ByStartPointDirectionLength(startPoint=pointAtParameter_9, direction=byCoordinates_17, length=code_block_53)
reverse_4 = List.Reverse(list=byStartPointDirectionLength_4)
code_block_54 = CodeBlock { -1; }
dropItems_3 = List.DropItems(list=reverse_4, amount=code_block_54)

# group: OUTPUT - Number of light passes through the shading
doesIntersect_2 = Geometry.DoesIntersect(geometry=dropItems_3, other=dropItems_2)
countTrue_2 = List.CountTrue(list=doesIntersect_2)
winter_number_of_blocked_rays = Watch(countTrue_2)  # graph output

color_palette = ColorPalette({R: 112, G: 128, B: 144, A: 255})
color_palette_2 = ColorPalette({R: 255, G: 215, B: 0, A: 255})
if_10 = If(test=doesIntersect_2, true=color_palette, false=color_palette_2)
byGeometryColor = Modifiers.GeometryColor.ByGeometryColor(geometry=dropItems_3, color=if_10)
code_block_55 = CodeBlock { lista+listb+listc; }  # unwired: lista, listb, listc
code_block_56 = CodeBlock(x=if_2) { -x*x/150+3; }

# group (continued): Wooden knots
byCenterPointRadiusNormal_2 = Circle.ByCenterPointRadiusNormal(centerPoint=pointAtParameter_5, radius=code_block_14, normal=normalAtPoint)

code_block_57 = CodeBlock(x=if_4) { -x*x/150+3; }

# group (continued): Wooden knots
byCenterPointRadiusNormal_3 = Circle.ByCenterPointRadiusNormal(centerPoint=pointAtParameter_7, radius=code_block_19, normal=normalAtPoint)
